# Grasshopper definition GHWorkflow.gh (Grasshopper 1.0.8)
# plug-ins: Human

# ---- group: Input
# Shape to Fabrication 2025
# ______________________________________________
# 
# WORKSHOP:
# Integrating AI models into Rhino 8: transforming Design Workflows with Computer vision Techniques
# 1
data = Data(0)

# ---- group: Control
data_2 = Data(0)

# ---- group: Operation
data_3 = Data(0)

# ---- group: Output
# AUTHORSHIP:
# Hesham Shawqy - Hesham.Shawqy@grimshaw.global
# 
# Esther Rubio Madroñal - Esther.RubioMadronal@grimshaw.global
# 
# Eve Tobey - eve.tobey@grimshaw.global
# 
# Ivana Petrusevski - ivana.petrusevski@grimshaw.global
# 
# Callum Sykes - callum@mcneel.com
data_4 = Data(0)

# ---- group: IO
data_5 = Data(0)

# ---- group: Check
data_6 = Data(0)

# ----
# Load models & Pipe
# Make sure you only run this once !!
py3 = Python3Script()  # -> out, pipe
# ---------- py3: Python ----------
import os
cache_path = 'Z:\\Development Projects\\huggingface'
os.environ["TRANSFORMERS_CACHE"] = cache_path
os.environ["HF_HUB_CACHE"] = cache_path
os.environ["HF_HOME"] = cache_path

import sys, threading, time
import os.path as op
import scriptcontext as sc
from System.Drawing import Size

# Path to the Conda environment
CONDA_ENV = r'C:\Users\Hesham.Shawqy\anaconda3\envs\generative_ai'

# # Add site-packages and DLL directories
sys.path.append(op.join(CONDA_ENV, r"Lib\site-packages"))
os.add_dll_directory(op.join(CONDA_ENV, r'Library\bin'))


import torch
from diffusers import StableDiffusionXLControlNetPipeline, ControlNetModel
from controlnet_aux import AnylineDetector
from PIL import Image
import numpy as np
from huggingface_hub import hf_hub_download


pipe = None


# model control
def load_pipeline():
    # Model configuration
    base_model_id = "SG161222/RealVisXL_V4.0"  
    controlnet_model_id = "xinsir/controlnet-canny-sdxl-1.0"
    repo_name = "ByteDance/Hyper-SD"
    ckpt_name = "Hyper-SDXL-8steps-lora.safetensors"
    
    # Load models
    controlnet = ControlNetModel.from_pretrained(controlnet_model_id, torch_dtype=torch.float16)
    pipe = StableDiffusionXLControlNetPipeline.from_pretrained(base_model_id, controlnet=controlnet, 
                                                              torch_dtype=torch.float16)
    
    # Setup LoRA weights
    lora_path = hf_hub_download(repo_name, ckpt_name)
    pipe.load_lora_weights(lora_path)
    pipe.fuse_lora(lora_scale=0.125)
    
    # Configure hardware
    if torch.cuda.is_available():
        pipe = pipe.to("cuda")
        pipe.enable_model_cpu_offload()
    
    return pipe


pipe = load_pipeline()
print(pipe)
# ---------- end py3 ----------

# ---- group: Changes control and trigger
dom = ConstructDomain(DomainStart=Slider(1.6, range=0..10), DomainEnd=Slider(2.5, range=0..10))
div = DivideDomain(Domain=dom, Count=10)
dedomain = DeconstructDomain(Domain=div)  # -> Start, End
trigger = Trigger(Interval=1000, TimerInterval=1000, Target=py3_2)
py3_2 = Python3Script(reset=Button(), x=dedomain.End)  # -> out, a, b; inputs reset: Boolean, x: list
# ---------- py3_2: Python ----------
step = 1

if 'counter' not in globals():
    counter = 0

if reset:
    counter = 0
elif counter<(len(x)-1):
    counter += step


a = x[counter]
print(a)
b = counter
# ---------- end py3_2 ----------
lng = ListLength(List=dedomain.End)
smaller = SmallerThan(FirstNumber=py3_2.b, SecondNumber=expr("x-1", lng))  # -> SmallerThan, OrEqualTo
num = Number(py3_2.b)
gate = StreamGate(Stream=py3_2.a, Gate=smaller.SmallerThan)  # -> Target0, Target1
gate_2 = StreamGate(Stream=num, Gate=smaller.SmallerThan)  # -> Target0, Target1

# ----
panel = Panel(py3.pipe)

# ---- group: Generate geometry
number_slider = Slider(2.5, range=0..10)
pt = Point(graft([<point referenced from the Rhino model> x5]))
cir = Circle(Plane=pt, Radius=Slider(3, range=0..10))
cir_2 = Circle(Plane=pt, Radius=Slider(3.7, range=0..10))
cir_3 = Circle(Plane=pt, Radius=gate.Target1)
cir_4 = Circle(Plane=pt, Radius=Slider(2.7, range=0..10))
number_slider_2 = Slider(1.2, range=0..10)
addition = Addition(A=number_slider_2, B=Slider(1.9, range=0..10))
addition_2 = Addition(A=addition, B=Slider(1.3, range=0..10))
Z = UnitZ(Factor=number_slider_2)
Z_2 = UnitZ(Factor=addition)
Z_3 = UnitZ(Factor=addition_2)
move = Move(Geometry=cir_2, Motion=Z)  # -> Geometry, Transform
move_2 = Move(Geometry=cir_4, Motion=Z_2)  # -> Geometry, Transform
move_3 = Move(Geometry=cir_3, Motion=Z_3)  # -> Geometry, Transform
merge = Merge(Data1=cir, Data2=move.Geometry, Data3=move_2.Geometry, Data4=move_3.Geometry)
loft = Loft(Curves=merge, Options={Adjust=False, Closed=False, LoftEnds=0, LoftSimp=0, LoftType=0, Rebuild=10, Refit=0.01})
divide = DivideCurve(Curve=cir, Count=Slider(40, range=0..100), Kinks=False)  # -> Points, Tangents, Parameters
srf_cp = SurfaceClosestPoint(Point=divide.Points, Surface=loft)  # -> Point, UVPoint, Distance
pt_2 = Point(srf_cp.Point)
crv_cp = CurveClosestPoint(Point=pt_2, Curve=cir)  # -> Point, Parameter, Distance
hframe = HorizontalFrame(Curve=cir, Parameter=crv_cp.Parameter)
iso = IsoCurve(Surface=loft, UVPoint=srf_cp.UVPoint)  # -> UIsocurve, VIsocurve
rectangle = Rectangle(Plane=hframe, XSize=Slider(0.3, range=0..1), YSize=Slider(0.2, range=0..1), Radius=0)  # -> Rectangle, Length
area = Area(Geometry=rectangle.Rectangle)  # -> Area, Centroid
vec2pt = Vector2Pt(PointA=area.Centroid, PointB=pt_2, Unitize=False)  # -> Vector, Length
move_4 = Move(Geometry=rectangle.Rectangle, Motion=vec2pt.Vector)  # -> graft(Geometry), Transform
swp1 = Sweep1(Rail=iso.UIsocurve, Sections=move_4.Geometry, Miter=1)

# ----
panel_2 = Panel(py3_2.b)
panel_3 = Panel(smaller.SmallerThan)
panel_4 = Panel(gate_2.Target1)

# ----
# Generate image(s)
# 2
# 2.1. Still image
folder_to_save_your_image = Panel("C:\Users\Hesham.Shawqy\Desktop\ExportTests\geometry_steps_test_2")
image_name = Panel("ImageTest")
prompt = Panel("a stunning view of a cluster of modular pavilions nestled within the lush Brazilian jungle, the roof is built using woven bamboo elements, surrounded by majestic mountains rising in the background and a serene river flowing in the foreground, the trees are way taller than the pavilions, earthy tones that blend harmoniously with the yellowish greens of the surrounding jungle, volumetric sunlight goes across the jungle, creating fascinating light rays, 4k, high resolution, realistic render, architectural visualization")
negative_prompt = Panel("ugly, low quality")
seed = Slider(50, range=0..100)
steps = Slider(8, range=0..10)
strength = Slider(0.5, range=0..1)
# 2.2. Camera path
scale = Slider(5, range=0..10)
run = Button()

folder_to_save_your_image_2 = Panel("C:\Users\Hesham.Shawqy\Desktop\ExportTests\CameraPath")
image_name_2 = Panel("CameraPath")
prompt_2 = Panel("a stunning view of a cluster of modular pavilions nestled within the lush Brazilian jungle, the roof is built using woven bamboo elements, surrounded by majestic mountains rising in the background and a serene river flowing in the foreground, the trees are way taller than the pavilions, earthy tones that blend harmoniously with the yellowish greens of the surrounding jungle, volumetric sunlight goes across the jungle, creating fascinating light rays, 4k, high resolution, realistic render, architectural visualization")
negative_prompt_2 = Panel("ugly, low quality")
seed_2 = Slider(50, range=0..100)
steps_2 = Slider(8, range=0..10)
strength_2 = Slider(0.5, range=0..1)
scale_2 = Slider(5, range=0..10)
run_2 = Button()

# ----
# 2.3. Geometry changes
folder_to_save_your_image_3 = Panel("C:\Users\Hesham.Shawqy\Desktop\ExportTests\GeometryChange02")
image_name_3 = Panel("GeometryChanges")
prompt_3 = Panel("a stunning view of a cluster of modular pavilions nestled within the lush Brazilian jungle, the roof is built using woven bamboo elements, surrounded by majestic mountains rising in the background and a serene river flowing in the foreground, the trees are way taller than the pavilions, earthy tones that blend harmoniously with the yellowish greens of the surrounding jungle, volumetric sunlight goes across the jungle, creating fascinating light rays, 4k, high resolution, realistic render, architectural visualization")
negative_prompt_3 = Panel("ugly, low quality")
seed_3 = Slider(50, range=0..100)
steps_3 = Slider(8, range=0..10)
strength_3 = Slider(0.5, range=0..1)
scale_3 = Slider(5, range=0..10)

# ---- group: Camera path set up
crv = Curve(<curve referenced from the Rhino model>)
dom_2 = ConstructDomain(DomainStart=0, DomainEnd=1)
div_2 = DivideDomain(Domain=dom_2, Count=10)
dedomain_2 = DeconstructDomain(Domain=div_2)  # -> Start, End
eval = EvaluateCurve(Curve=reparameterize(crv), Parameter=dedomain_2.End)  # -> Point, Tangent, Angle
pt_3 = Point(<point referenced from the Rhino model>)

# ---- group: Still image
py3_3 = Python3Script(
    run=run,
    pipe=py3.pipe,
    save_path=folder_to_save_your_image,
    title=image_name,
    prompt=prompt,
    negative_prompt=negative_prompt,
    seed=seed,
    steps=steps,
    strength=strength,
    scale=scale)  # -> out, a; inputs run: Boolean, save_path: String, title: String, prompt: String, negative_prompt: String, seed: Int32, steps: Int32, strength: Double, scale: Int32
# ---------- py3_3: Python ----------
import sys, os, threading, time, tempfile
import os.path as op
import scriptcontext as sc
from System.Drawing import Size
from controlnet_aux import AnylineDetector

# Path to the Conda environment
CONDA_ENV = r'C:\Users\Hesham.Shawqy\anaconda3\envs\generative_ai'

# # Add site-packages and DLL directories
sys.path.append(op.join(CONDA_ENV, r"Lib\site-packages"))
os.add_dll_directory(op.join(CONDA_ENV, r'Library\bin'))
import io

import scriptcontext as sc
import System.Drawing.Imaging as sdi
import System.Drawing as sd
from System.Drawing import Size
from PIL import Image, ImageOps, ImageFilter
import numpy as np
import cv2
from System.IO import MemoryStream
import torch
import glob
import contextlib

######################################

def capture_viewport():
    view = sc.doc.Views.ActiveView
    bitmap = view.CaptureToBitmap()
    
    with tempfile.NamedTemporaryFile(suffix='.png', delete=False) as temp_file:
        temp_path = temp_file.name
    
    bitmap.Save(temp_path, sdi.ImageFormat.Png)
    pil_image = Image.open(temp_path)
    
    return pil_image

def resize_image_small(image, max_size=1024):
    def make_divisible_by_8(value):
        return (value // 8) * 8

    width, height = image.size
    if width > max_size or height > max_size:
        if width > height:
            new_width = max_size
            new_height = int((max_size / width) * height)
        else:
            new_height = max_size
            new_width = int((max_size / height) * width)
        new_width = make_divisible_by_8(new_width)
        new_height = make_divisible_by_8(new_height)
        image = image.resize((new_width, new_height), Image.LANCZOS)
    
    width, height = image.size
    width = make_divisible_by_8(width)
    height = make_divisible_by_8(height)
    
    return image.resize((width, height), Image.LANCZOS)
       
def preprocess_image(image):
    img_processor = AnylineDetector.from_pretrained("TheMistoAI/MistoLine", filename="MTEED.pth", subfolder="Anyline")
    edges_rgb = img_processor(image)
    if isinstance(edges_rgb, np.ndarray):
        edges_rgb = Image.fromarray(edges_rgb)
    
    #edges_rgb.show()
    return edges_rgb

def generate_image(bitmap, seed: int, prompt: str, negative_prompt: str, steps: int = 8, strength: float = 0.5, scale: int=5):
        try:

            resized_image = resize_image_small(pil_image)
            enhanced_image = preprocess_image(resized_image)


            generator = torch.Generator(device="cuda" if torch.cuda.is_available() else "cpu").manual_seed(int(seed))

            with torch.inference_mode():
                result = pipe(
                    prompt=prompt,
                    negative_prompt=negative_prompt,
                    image=enhanced_image,
                    guidance_scale=int(scale),
                    num_inference_steps=int(steps),
                    num_images_per_prompt=int(1),
                    controlnet_conditioning_scale=float(strength),
                    generator=generator,  # Pass the seed generator
                )

                return result.images[0]
        except Exception as e:
            print(f"Error generating image: {e}")
            return None

def pil_to_bitmap(pil_image):
    new_file_path = save_path + "\\" + title + ".png"
    pil_image.save(new_file_path, format='PNG')
    bitmap = sd.Bitmap(new_file_path)

    return bitmap

######################################

view = sc.doc.Views.ActiveView
vp = view.ActiveViewport

if run:
    pil_image = capture_viewport()
    generated_image = generate_image(pil_image,seed,prompt,negative_prompt,steps,strength,scale)
    #generated_image.show()

    pil_to_bitmap(generated_image)
# ---------- end py3_3 ----------

# ---- group: Camera path
py3_4 = Python3Script(
    run=run_2,
    pipe=py3.pipe,
    save_path=folder_to_save_your_image_2,
    title=image_name_2,
    cameras=eval.Point,
    target=pt_3,
    prompt=prompt_2,
    negative_prompt=negative_prompt_2,
    seed=seed_2,
    steps=steps_2,
    strength=strength_2,
    scale=scale_2)  # -> out, a; inputs run: Boolean, save_path: String, title: String, cameras: list of Point3d, target: Point3d, prompt: String, negative_prompt: String, seed: Int32, steps: Int32, strength: Double, scale: Int32
# ---------- py3_4: Python ----------
import sys, os, threading, time, tempfile
import os.path as op
import scriptcontext as sc
from System.Drawing import Size
from controlnet_aux import AnylineDetector

# Path to the Conda environment
CONDA_ENV = r'C:\Users\Hesham.Shawqy\anaconda3\envs\generative_ai'

# # Add site-packages and DLL directories
sys.path.append(op.join(CONDA_ENV, r"Lib\site-packages"))
os.add_dll_directory(op.join(CONDA_ENV, r'Library\bin'))
import io

import scriptcontext as sc
import System.Drawing.Imaging as sdi
import System.Drawing as sd
from System.Drawing import Size
from PIL import Image, ImageOps, ImageFilter
import numpy as np
import cv2
from System.IO import MemoryStream
import torch
import glob
import contextlib

######################################

def capture_viewport():
    view = sc.doc.Views.ActiveView
    bitmap = view.CaptureToBitmap()
    
    with tempfile.NamedTemporaryFile(suffix='.png', delete=False) as temp_file:
        temp_path = temp_file.name
    
    bitmap.Save(temp_path, sdi.ImageFormat.Png)
    pil_image = Image.open(temp_path)
    
    return pil_image

def resize_image_small(image, max_size=1024):
    def make_divisible_by_8(value):
        return (value // 8) * 8

    width, height = image.size
    if width > max_size or height > max_size:
        if width > height:
            new_width = max_size
            new_height = int((max_size / width) * height)
        else:
            new_height = max_size
            new_width = int((max_size / height) * width)
        new_width = make_divisible_by_8(new_width)
        new_height = make_divisible_by_8(new_height)
        image = image.resize((new_width, new_height), Image.LANCZOS)
    
    width, height = image.size
    width = make_divisible_by_8(width)
    height = make_divisible_by_8(height)
    
    return image.resize((width, height), Image.LANCZOS)
       
def preprocess_image(image):
    img_processor = AnylineDetector.from_pretrained("TheMistoAI/MistoLine", filename="MTEED.pth", subfolder="Anyline")
    edges_rgb = img_processor(image)
    if isinstance(edges_rgb, np.ndarray):
        edges_rgb = Image.fromarray(edges_rgb)
    
    #edges_rgb.show()
    return edges_rgb

def generate_image(bitmap, seed: int, prompt: str, negative_prompt: str, steps: int = 8, strength: float = 0.5, scale: int=5):
        try:

            resized_image = resize_image_small(pil_image)
            enhanced_image = preprocess_image(resized_image)


            generator = torch.Generator(device="cuda" if torch.cuda.is_available() else "cpu").manual_seed(int(seed))

            with torch.inference_mode():
                result = pipe(
                    prompt=prompt,
                    negative_prompt=negative_prompt,
                    image=enhanced_image,
                    guidance_scale=int(scale),
                    num_inference_steps=int(steps),
                    num_images_per_prompt=int(1),
                    controlnet_conditioning_scale=float(strength),
                    generator=generator,  # Pass the seed generator
                )

                return result.images[0]
        except Exception as e:
            print(f"Error generating image: {e}")
            return None

def pil_to_bitmap(pil_image,version):
    new_file_path = save_path + "\\" + title + str(version) + ".png"
    pil_image.save(new_file_path, format='PNG')
    bitmap = sd.Bitmap(new_file_path)

    return bitmap

######################################

view = sc.doc.Views.ActiveView
vp = view.ActiveViewport

if run:
    for index, camera in enumerate(cameras):
        vp.SetCameraLocation(camera, False)
        vp.SetCameraDirection(target - camera, True)
        view.Redraw()
        pil_image = capture_viewport()
        generated_image = generate_image(pil_image,seed,prompt,negative_prompt,steps,strength,scale)
        #generated_image.show()

        pil_to_bitmap(generated_image,index)
# ---------- end py3_4 ----------

# ---- group: Geometry changes
py3_5 = Python3Script(
    run=gate_2.Target1,
    number=num,
    pipe=py3.pipe,
    save_path=folder_to_save_your_image_3,
    title=image_name_3,
    prompt=prompt_3,
    negative_prompt=negative_prompt_3,
    seed=seed_3,
    steps=steps_3,
    strength=strength_3,
    scale=scale_3)  # -> out, a; inputs run: Boolean, save_path: String, title: String, prompt: String, negative_prompt: String, seed: Int32, steps: Int32, strength: Double, scale: Int32; disabled
# ---------- py3_5: Python ----------
import sys, os, threading, time, tempfile
import os.path as op
import scriptcontext as sc
from System.Drawing import Size
from controlnet_aux import AnylineDetector

# Path to the Conda environment
CONDA_ENV = r'C:\Users\Hesham.Shawqy\anaconda3\envs\generative_ai'

# # Add site-packages and DLL directories
sys.path.append(op.join(CONDA_ENV, r"Lib\site-packages"))
os.add_dll_directory(op.join(CONDA_ENV, r'Library\bin'))
import io

import scriptcontext as sc
import System.Drawing.Imaging as sdi
import System.Drawing as sd
from System.Drawing import Size
from PIL import Image, ImageOps, ImageFilter
import numpy as np
import cv2
from System.IO import MemoryStream
import torch
import glob
import contextlib

######################################

def capture_viewport():
    view = sc.doc.Views.ActiveView
    bitmap = view.CaptureToBitmap()
    
    with tempfile.NamedTemporaryFile(suffix='.png', delete=False) as temp_file:
        temp_path = temp_file.name
    
    bitmap.Save(temp_path, sdi.ImageFormat.Png)
    pil_image = Image.open(temp_path)
    
    return pil_image

def resize_image_small(image, max_size=1024):
    def make_divisible_by_8(value):
        return (value // 8) * 8

    width, height = image.size
    if width > max_size or height > max_size:
        if width > height:
            new_width = max_size
            new_height = int((max_size / width) * height)
        else:
            new_height = max_size
            new_width = int((max_size / height) * width)
        new_width = make_divisible_by_8(new_width)
        new_height = make_divisible_by_8(new_height)
        image = image.resize((new_width, new_height), Image.LANCZOS)
    
    width, height = image.size
    width = make_divisible_by_8(width)
    height = make_divisible_by_8(height)
    
    return image.resize((width, height), Image.LANCZOS)
       
def preprocess_image(image):
    img_processor = AnylineDetector.from_pretrained("TheMistoAI/MistoLine", filename="MTEED.pth", subfolder="Anyline")
    edges_rgb = img_processor(image)
    if isinstance(edges_rgb, np.ndarray):
        edges_rgb = Image.fromarray(edges_rgb)
    
    #edges_rgb.show()
    return edges_rgb

def generate_image(bitmap, seed: int, prompt: str, negative_prompt: str, steps: int = 8, strength: float = 0.5, scale: int=5):
        try:

            resized_image = resize_image_small(pil_image)
            enhanced_image = preprocess_image(resized_image)


            generator = torch.Generator(device="cuda" if torch.cuda.is_available() else "cpu").manual_seed(int(seed))

            with torch.inference_mode():
                result = pipe(
                    prompt=prompt,
                    negative_prompt=negative_prompt,
                    image=enhanced_image,
                    guidance_scale=int(scale),
                    num_inference_steps=int(steps),
                    num_images_per_prompt=int(1),
                    controlnet_conditioning_scale=float(strength),
                    generator=generator,  # Pass the seed generator
                )

                return result.images[0]
        except Exception as e:
            print(f"Error generating image: {e}")
            return None

def pil_to_bitmap(pil_image,version):
    new_file_path = save_path + "\\" + title + str(version) + ".png"
    pil_image.save(new_file_path, format='PNG')
    bitmap = sd.Bitmap(new_file_path)

    return bitmap

######################################

view = sc.doc.Views.ActiveView
vp = view.ActiveViewport

if run:
    pil_image = capture_viewport()
    generated_image = generate_image(pil_image,seed,prompt,negative_prompt,steps,strength,scale)
    #generated_image.show()

    pil_to_bitmap(generated_image,number)
# ---------- end py3_5 ----------

# ----
wires = BrepWireframe(Brep=swp1, Density=-1)
previewlw = CustomPreviewLineweights(Geometry=wires, Shader=ColourSwatch(SwatchColor=RGB(0, 0, 0)), Absolute=False)
preview = CustomPreview(Geometry=swp1, Material=ColourSwatch(SwatchColor=RGB(255, 255, 255)))

# ----
# Generate gif from frames
# 3
folder_with_frames = Panel("C:\Users\Hesham.Shawqy\Desktop\ExportTests\CameraPath\CameraPath*.png")
file_to_save = Panel("C:\Users\Hesham.Shawqy\Desktop\ExportTests\CameraPath\CameraPath.gif")
py3_6 = Python3Script(run=Button(), folder=folder_with_frames, exp_file=file_to_save)  # -> out, a; inputs run: Boolean, folder: String, exp_file: String
# ---------- py3_6: Python ----------
import sys, os, threading, time, tempfile
import os.path as op
import scriptcontext as sc
from System.Drawing import Size
from controlnet_aux import AnylineDetector
# Path to the Conda environment
CONDA_ENV = r'C:\Users\Hesham.Shawqy\anaconda3\envs\generative_ai'

# # Add site-packages and DLL directories
sys.path.append(op.join(CONDA_ENV, r"Lib\site-packages"))
os.add_dll_directory(op.join(CONDA_ENV, r'Library\bin'))

import glob
import contextlib
from PIL import Image

# filepaths
fp_in = folder
fp_out = exp_file

# use exit stack to automatically close opened images
if run:
    with contextlib.ExitStack() as stack:

        # lazily load images
        imgs = (stack.enter_context(Image.open(f))
                for f in sorted(glob.glob(fp_in)))

        # extract  first image from iterator
        img = next(imgs)

        # https://pillow.readthedocs.io/en/stable/handbook/image-file-formats.html#gif
        img.save(fp=fp_out, format='GIF', append_images=imgs,
                save_all=True, duration=200, loop=0)
# ---------- end py3_6 ----------
