# Grasshopper definition Depth map GH.gh (Grasshopper 1.0.8)
# plug-ins: Heteroptera

number_slider = Slider(100, range=0..100)
number_slider_2 = Slider(200, range=0..1000)
number_slider_3 = Slider(200, range=0..1000)
geo = Geometry(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)

# ---- group: OG image
path = FilePath("C:\Users\vr_service\Pictures\facadeA.jpg")

# ---- group: depth map
path_2 = FilePath("C:\Users\vr_service\Pictures\capture3.png")

# ----
img = ImportImage(File=path, Rectangle=geo, XSamples=number_slider_2, YSamples=number_slider_3)
img_2 = ImportImage(File=path_2, Rectangle=geo, XSamples=number_slider_2, YSamples=number_slider_3)
demesh = DeconstructMesh(Mesh=img)  # -> Vertices, Faces, Colours, Normals
demesh_2 = DeconstructMesh(Mesh=img_2)  # -> Vertices, Faces, Colours, Normals
number_slider_4 = Slider(100, range=0..100)
cp = ClosestPoint(Point=graft(demesh.Vertices), Cloud=demesh_2.Vertices)  # -> ClosestPoint, CPIndex, Distance
item = ListItem(List=demesh_2.Colours, Index=flatten(cp.CPIndex), Wrap=True)
edge = Normalizer(Numbers=item)
graph = GraphMapper(edge, x0=0, x1=1, y0=0, y1=1, container_name="Bezier", cpx=[0, 0.25, 1, 1], cpy=[0, 0.25, 0, 1])
dom = ConstructDomain(DomainStart=Slider(175, range=0..1000), DomainEnd=Slider(1, range=0..1))
bnd = Bounds(Numbers=graph)
Z = UnitZ(Factor=1)
remap = RemapNumbers(Value=graph, Source=bnd, Target=dom)  # -> Mapped, Clipped
amp = Amplitude(Vector=Z, Amplitude=remap.Mapped)
move = Move(Geometry=demesh.Vertices, Motion=amp)  # -> Geometry, Transform
conmesh = ConstructMesh(Vertices=move.Geometry, Faces=demesh.Faces, Colours=demesh.Colours)
